# Grasshopper definition circle.gh (Grasshopper 1.0.8)

# ---- group: Test Circle of Radius 3
number_slider = Slider(3, range=0..10)
testcircle = Circle(Plane=PlaneXY(0, 0, 0), Radius=number_slider)
end = EndPoints(Curve=testcircle)  # -> Start, End
pdecon = Deconstruct(Point=end.Start)  # -> XComponent, YComponent, ZComponent
panel = Panel(pdecon.XComponent)
equals = Equality(FirstNumber=pdecon.XComponent, SecondNumber=number_slider)  # -> Equality, Inequality

# ----
panel_2 = Panel(equals.Equality)
context_bake = ContextBake(Content=equals.Equality)
